# Dynamo graph 02_cad to pipe.dyn (Dynamo 2.12.1.8246)
# packages: Data-Shapes 2023.2.112, bimorphNodes 5.1.3, Clockwork for Dynamo 2.x 2.6.0, Plissken 2016.7.19

code_block = CodeBlock { "Convert CAD lines into model lines"; }
file_path = Filename("..\..\Users\LENOVO-PC\Downloads\C_type_black_Logo Valbek basic CMYK.png")
file_from_path = FileObject(path=file_path)
readFromFile = Image.ReadFromFile(file=file_from_path)
code_block_2 = CodeBlock { "Run"; }
code_block_3 = CodeBlock { "Open the CAD file to be converted"; }
textnote_data = Custom[TextNote Data](TextNote=code_block_3)  # package Data-Shapes; Create Data for TextNote input in UI.MultipleInputForm ++ . Check out www.data-shapes.net for more informations
code_block_4 = CodeBlock { "Select CAD Import"; }
code_block_5 = CodeBlock { true; }
selectmodelelements_data = Custom[SelectModelElements Data](ButtonText=code_block_4, SelectSingleElement=code_block_5)  # package Data-Shapes; Creates a Revit element selection input for UI.MultipleInputForm++ . Check out www.data-shapes.net for more infos!
code_block_6 = CodeBlock { "Remove lines shorter than ... inch/meter"; }
code_block_7 = CodeBlock { 0.25; }
code_block_8 = CodeBlock { 72; }
slider = Custom[Slider](InputName=code_block_6, Minimum=code_block_7, Maximum=code_block_8, Default_Value=code_block_7, Step=code_block_7)  # package Data-Shapes; Creates slider input for UI.MultipleInputForm ++ . Set the step to decimal value if you want a double slider, or to a integer value if you want an integer slider.
code_block_9 = CodeBlock { "Pipe types"; }
element_types = ElementTypes("PipeType")
all_elements_of_type = ElementsOfType(element_type=element_types)
name = Element.Name(element=all_elements_of_type)
dropdown_data = Custom[DropDown Data](InputName=code_block_9, Keys=name, Values=all_elements_of_type)  # package Data-Shapes; Create data for DropDown input in UI.MultiInputForm ++ . Check out www.data-shapes.net for more infos.
code_block_10 = CodeBlock { "Pipe systems"; }
element_types_2 = ElementTypes("PipingSystemType")
all_elements_of_type_2 = ElementsOfType(element_type=element_types_2)
name_2 = Element.Name(element=all_elements_of_type_2)
dropdown_data_2 = Custom[DropDown Data](InputName=code_block_10, Keys=name_2, Values=all_elements_of_type_2)
code_block_11 = CodeBlock { "Level"; }
code_block_12 = CodeBlock { true; }
collectLevels = Custom[CollectLevels](code_block_12)  # package Plissken; Collect all levels in the current project.
flatten = List.Flatten(list=collectLevels.Name)
flatten_2 = List.Flatten(list=collectLevels.Element)
dropdown_data_3 = Custom[DropDown Data](InputName=code_block_11, Keys=flatten, Values=flatten_2)
list_create = List.Create(item0=textnote_data, item1=selectmodelelements_data, item2=slider, item3=dropdown_data, item4=dropdown_data_2, item5=dropdown_data_3)

# group: 00
boolean = BoolSelector(false)

code_block_13 = CodeBlock { "Cancel"; }
multipleinputform = Custom[MultipleInputForm ++](Description_optional=code_block, Logo_optional=readFromFile, ButtonText_optional=code_block_2, Inputs=list_create, Toggle=boolean, CancelButtonText_optional=code_block_13)  # package Data-Shapes; Create a form with multiple inputs. see www.data-shapes.net for tutorials and infos!
code_block_14 = CodeBlock(cadimport=multipleinputform.User_Inputs, shorterthan=multipleinputform.User_Inputs) { cadimport[0]; shorterthan[1]; }
code_block_15 = CodeBlock { "Convert Cad to Model Lines"; }
code_block_16 = CodeBlock { "Run"; }
code_block_17 = CodeBlock { "Determine which Layer contains the Pipe centerlines."; }
textnote_data_2 = Custom[TextNote Data](TextNote=code_block_17)
code_block_18 = CodeBlock { "Select Layer"; }
layerNames = Revit.ImportInstance.LayerNames(importInstance=code_block_14.out0)
string_from_object = FromObject(object=layerNames)
flatten_3 = List.Flatten(list=string_from_object)
flatten_4 = List.Flatten(list=layerNames)
listview_data = Custom[Listview Data](InputName=code_block_18, Keys=flatten_3, Values=flatten_4)  # package Data-Shapes; Create data for ListView input in UI.MultiInputForm ++ . Check out www.data-shapes.net for more infos.
firstItem = List.FirstItem(list=listview_data)
list_create_2 = List.Create(item0=textnote_data_2, item1=firstItem)
code_block_19 = CodeBlock { "Cancel"; }
multipleinputform_2 = Custom[MultipleInputForm ++](Description_optional=code_block_15, Logo_optional=readFromFile, ButtonText_optional=code_block_16, Inputs=list_create_2, CancelButtonText_optional=code_block_19)
boolean_2 = BoolSelector(false)
curvesFromCADLayers = CAD.CurvesFromCADLayers(importInstance=code_block_14.out0, layerNames=multipleinputform_2.User_Inputs, createModelCurves=boolean_2)
geometry = Element.Geometry(element=curvesFromCADLayers.Curve)
flatten_5 = List.Flatten()  # unwired: list
length = Curve.Length(curve=flatten_5)
gt = length > code_block_14.out1
filterByBoolMask = List.FilterByBoolMask(list=curvesFromCADLayers.Curve@L2, mask=gt@L2)
delete = Element.Delete(element=filterByBoolMask.out)

# group: USER INTERFENCE SYSTEMS
code_block_20 = CodeBlock(IN0=multipleinputform_2.User_Inputs) { IN0[0]; }

string_from_object_2 = FromObject(object=code_block_20)
fromElements = Custom[Group.FromElements](elements=filterByBoolMask.in, groupName=string_from_object_2)  # package Clockwork for Dynamo 2.x
multipleinputform_3 = Custom[MultipleInputForm ++]()  # unwired: Inputs
