# Dynamo graph CAD - Create Model Lines From CAD Lines, Name Group.dyn (Dynamo 2.12.0.5650)
# packages: bimorphNodes 4.1.1, Data-Shapes 2022.2.100

code_block = CodeBlock { "Run"; }
code_block_2 = CodeBlock { "Select CAD Import"; }
code_block_3 = CodeBlock { true; }
selectmodelelements_data = Custom[SelectModelElements Data](ButtonText=code_block_2, SelectSingleElement=code_block_3)  # package Data-Shapes; Creates a Revit element selection input for UI.MultipleInputForm++ . Check out www.data-shapes.net for more infos!
code_block_4 = CodeBlock { "Name for Group of Lines being created. (Group Names must be unique!)"; }
code_block_5 = CodeBlock { "Group 1"; }
textbox_data = Custom[TextBox Data](InputName=code_block_4, DefaultText=code_block_5)  # package Data-Shapes; Create Data for TextBox input in UI.MultipleInputForm ++ . Check out www.data-shapes.net for more informations

# group: Reset
# note: (Set to False and Run to refresh the graph. Set to True when you're ready to Run again.)
RESET = BoolSelector(true)

# group: Creates a User Interface
code_block_6 = CodeBlock { "Convert Cad Lines to Model Lines"; }
code_block_7 = CodeBlock { "Open the CAD file to be converted into Revit Pipe."; }
code_block_8 = CodeBlock { "Cancel"; }

textnote_data = Custom[TextNote Data](TextNote=code_block_7)  # package Data-Shapes; Create Data for TextNote input in UI.MultipleInputForm ++ . Check out www.data-shapes.net for more informations

# group (continued): Creates a User Interface
create = List.Create(item0=textnote_data, item1=selectmodelelements_data, item2=textbox_data)
# note: Package:  Data-Shapes
multipleinputform = Custom[MultipleInputForm ++](Description_optional=code_block_6, ButtonText_optional=code_block, Inputs=create, Toggle=RESET, CancelButtonText_optional=code_block_8)  # package Data-Shapes; Create a form with multiple inputs. see www.data-shapes.net for tutorials and infos!

code_block_9 = CodeBlock(cadimport=multipleinputform.User_Inputs, groupname=multipleinputform.User_Inputs) { cadimport[0]; groupname[1]; }
layerNames = Revit.ImportInstance.LayerNames(importInstance=code_block_9.out0)

# group: Creates a User Interface
layerNames_2 = CAD.LayerNames()  # unwired: importInstance
code_block_10 = CodeBlock { "Convert Cad Lines to Model Lines"; }
code_block_11 = CodeBlock { "Run"; }
code_block_12 = CodeBlock { "Determine which Layer contains the Pipe centerlines. If there is not a Layer containing Pipe Centerlines, you will need to create one. Select the Layer containing Pipe Centerlines to convert them to Revit Model Lines."; }
ui_textnote_data = Custom[UI.TextNote Data](TextNote=code_block_12)  # package Data-Shapes; Create Data for TextNote input in UI.MultipleInputForm ++ . Check out www.data-shapes.net for more informations
code_block_13 = CodeBlock { "Select Layer"; }
string_from_object = FromObject(obj=layerNames)
flatten = List.Flatten(list=string_from_object)
flatten_2 = List.Flatten(list=layerNames)
ui_listview_data = Custom[UI.Listview Data](InputName=code_block_13, Keys=flatten, Values=flatten_2)  # package Data-Shapes; Create data for ListView input in UI.MultiInputForm ++ . Check out www.data-shapes.net for more infos.
firstItem = List.FirstItem(list=ui_listview_data)
create_2 = List.Create(item0=ui_textnote_data, item1=firstItem)
code_block_14 = CodeBlock { "Cancel"; }
# note: Package:  Data-Shapes
ui_multipleinputform = Custom[UI.MultipleInputForm ++](Description_optional=code_block_10, ButtonText_optional=code_block_11, Inputs=create_2, Toggle=RESET, CancelButtonText_optional=code_block_14)  # package Data-Shapes; Create a form with multiple inputs. see www.data-shapes.net for tutorials and infos!

# group: Extract CAD Lines by Layer
boolean = BoolSelector(true)
# note: Package:  BimorphNodes
curvesFromCADLayers = CAD.CurvesFromCADLayers(importInstance=code_block_9.out0, layerNames=ui_multipleinputform.User_Inputs, createModelCurves=boolean)

# group: Create a Group containing new Model Lines
string_from_object_2 = FromObject(obj=code_block_9.out1)
# note: Package:  Clockwork
fromElements = Custom[Group.FromElements](elements=curvesFromCADLayers.Curve, groupName=string_from_object_2)

code_block_15 = CodeBlock(IN0=ui_multipleinputform.User_Inputs) { IN0[0]; }
