# Dynamo graph CAD - Create Model Lines and Line Styles From CAD Lines, Group.dyn (Dynamo 2.12.1.8246)
# packages: bimorphNodes 5.1.3, Data-Shapes 2023.2.112, Clockwork for Dynamo 1.x 1.0.3, Plissken 2016.7.19

file_path = Filename("..\..\..\..\5 - Images\Logos\Slayden Logos 2019\Slayden-MWH-Black.jpg")
fromPath = FileObject(path=file_path)  # "File.FromPath"
readFromFile = Image.ReadFromFile(file=fromPath)
code_block = CodeBlock { "Run"; }
code_block_2 = CodeBlock { "Select CAD Import"; }
code_block_3 = CodeBlock { true; }
ui_selectmodelelements_data = Custom[UI.SelectModelElements Data](ButtonText=code_block_2, SelectSingleElement=code_block_3)  # package Data-Shapes; Creates a Revit element selection input for UI.MultipleInputForm++ . Check out www.data-shapes.net for more infos!

# group: Reset
# note: (Set to False and Run to refresh the graph. Set to True when you're ready to Run again.)
RESET = BoolSelector(true)  # graph input

# group: Creates a User Interface
code_block_4 = CodeBlock { "Convert Cad Lines to Model Lines"; }
code_block_5 = CodeBlock { "Open the CAD file to be converted into Revit Pipe."; }
ui_textnote_data = Custom[UI.TextNote Data](TextNote=code_block_5)  # package Data-Shapes; Create Data for TextNote input in UI.MultipleInputForm ++ . Check out www.data-shapes.net for more informations
create = List.Create(item0=ui_textnote_data, item1=ui_selectmodelelements_data)
code_block_6 = CodeBlock { "Cancel"; }
# note: Package:  Data-Shapes
ui_multipleinputform = Custom[UI.MultipleInputForm ++](Description_optional=code_block_4, Logo_optional=readFromFile, ButtonText_optional=code_block, Inputs=create, Toggle=RESET, CancelButtonText_optional=code_block_6)  # package Data-Shapes; Create a form with multiple inputs. see www.data-shapes.net for tutorials and infos!

code_block_7 = CodeBlock(cadimport=ui_multipleinputform.User_Inputs, shorterthan=ui_multipleinputform.User_Inputs) { cadimport[0]; shorterthan[1]; }
code_block_8 = CodeBlock { "Convert Cad Lines to Model Lines"; }
code_block_9 = CodeBlock { "Run"; }
code_block_10 = CodeBlock { "Select the Layer to Convert to Model Lines. Its Name and the selected Color will be used to create a new Revit Line Style. "; }
ui_textnote_data_2 = Custom[UI.TextNote Data](TextNote=code_block_10)
code_block_11 = CodeBlock { "Select Layer"; }
layerNamesInUse = CAD.LayerNamesInUse(importInstance=code_block_7.out0)
string_from_object = FromObject(obj=layerNamesInUse)
flatten = List.Flatten(list=string_from_object)
flatten_2 = List.Flatten(list=layerNamesInUse)
ui_listview_data = Custom[UI.Listview Data](InputName=code_block_11, Keys=flatten, Values=flatten_2)  # package Data-Shapes; Create data for ListView input in UI.MultiInputForm ++ . Check out www.data-shapes.net for more infos.
firstItem = List.FirstItem(list=ui_listview_data)
code_block_12 = CodeBlock { "Select Color for new Line Style"; }
ui_colorinput_data = Custom[UI.ColorInput Data](InputName=code_block_12)  # package Data-Shapes; Create a color selection input for UI.MultiInputForm++ . Check out www.data-shapes.net for more infos! Warning : Only works with Revit 2017
code_block_13 = CodeBlock { "Random Color(s) Instead?"; }
code_block_14 = CodeBlock { "Yes"; }
ui_boolean_input = Custom[UI.Boolean input](InputName=code_block_13, SideText=code_block_14)  # package Data-Shapes; Creates a boolean input for UI.MultipleInputForm ++ . Check out www.data-shapes.net for more infos!
create_2 = List.Create(item0=ui_textnote_data_2, item1=firstItem, item2=ui_colorinput_data, item3=ui_boolean_input)
code_block_15 = CodeBlock { "Cancel"; }
code_block_16 = CodeBlock { 1000; }
# note: Package:  Data-Shapes
ui_multipleinputform_2 = Custom[UI.MultipleInputForm ++](Description_optional=code_block_8, Logo_optional=readFromFile, ButtonText_optional=code_block_9, Inputs=create_2, Toggle=RESET, CancelButtonText_optional=code_block_15, Width_optional=code_block_16)
code_block_17 = CodeBlock(layerz=ui_multipleinputform_2.User_Inputs, colr=ui_multipleinputform_2.User_Inputs, rando=ui_multipleinputform_2.User_Inputs) { layerz[0]; colr[1]; rando[2]; }

# group: Extract CAD Lines by Layer
boolean = BoolSelector(true)
# note: Package:  BimorphNodes
curvesFromCADLayers = CAD.CurvesFromCADLayers(importInstance=code_block_7.out0, layerNames=code_block_17.out0, createModelCurves=boolean)
code_block_18 = CodeBlock { true; }
lineStylebyName = Custom[LineStylebyName](Bool=code_block_18, Name=curvesFromCADLayers.layerKeys, lacing=Longest)  # package Plissken; Retrieve a LineStyle by a given name
flatten_3 = List.Flatten(list=lineStylebyName)

code_block_19 = CodeBlock { "Line Style"; }
setParameterByName = Element.SetParameterByName(element=curvesFromCADLayers.Curve, parameterName=code_block_19, value=flatten_3)

# group: Create a Group containing new Model Lines
string_from_object_2 = FromObject(obj=code_block_17.out0)
# note: Package:  Clockwork
fromElements = Custom[Group.FromElements](elements=setParameterByName, groupName=string_from_object_2)  # package Clockwork for Dynamo 1.x; Creates a group from a list of Revit elements

flatten_4 = List.Flatten(list=code_block_17.out0)
count = List.Count(list=flatten_4)
