# Dynamo graph MEP - Add Pipe Insulation.dyn (Dynamo 2.12.1.8246)
# packages: MEPover 2022.10.30

# group: Select Pipes
select_model_elements = DSModelElementsSelection()  # 2 picked in the model

# group: Filter by Pipe Size
code_block = CodeBlock { "Size"; }
getParameterValueByName = Element.GetParameterValueByName(element=select_model_elements, parameterName=code_block)
contains = String.Contains(string=getParameterValueByName, searchFor=getParameterValueByName)
filterByBoolMask = List.FilterByBoolMask(list=select_model_elements, mask=contains)

string = StringInput("System Type")

# group: System Abbreviation
string_2 = StringInput("CHWS")

code_block_2 = CodeBlock { true; }

# group: Filter by System Abbreviation
getParameterValueByName_2 = Element.GetParameterValueByName(element=filterByBoolMask.in, parameterName=string)
contains_2 = String.Contains(string=getParameterValueByName_2, searchFor=string_2, ignoreCase=code_block_2)
filterByBoolMask_2 = List.FilterByBoolMask(list=filterByBoolMask.in, mask=contains_2)

element_types = ElementTypes("PipeInsulationType")
all_elements_of_type = ElementsOfType(element_type=element_types)
code_block_3 = CodeBlock { 1; }

# group: Filter by Name
getItemAtIndex = List.GetItemAtIndex(list=all_elements_of_type, index=code_block_3)

# group: Insulation Thickness in Decimal Inches
code_block_4 = CodeBlock { 0.167; }

# group: Won't work if Pipes already have insulation
# note: MEPover Package
addInsulation = Custom[Element.AddInsulation](elements=filterByBoolMask_2.in, InsulationType=getItemAtIndex, Thickness=code_block_4)  # package MEPover; Adds insulation to pipe or duct networks

# group: Size of Pipes/Fittings to Apply Insulation
string_3 = StringInput("200")

# group: Piping system type
# note: Set to PipeInsulationType
element_types_2 = ElementTypes("PipingSystemType")
