# Dynamo graph MEP - Get Piping System Types as List.dyn "x" (Dynamo 2.0.1.5055)

# note: (PipingSystemType)
element_types = ElementTypes(index=230)
boolean = BoolSelector(false)
allElementTypesOf = Custom[Springs.Collector.AllElementTypesOf](CategoryOrElemType=element_types, refresh=boolean)  # Works with either categories, element types or revit classed . Can be applied as a function. No ties to the Document.Changed event.
parameters = Element.Parameters(element=allElementTypesOf)
code_block = CodeBlock { "System Type"; }
getParameterValueByName = Element.GetParameterValueByName(element=parameters, parameterName=code_block)
name = Element.Name(element=getParameterValueByName)
flatten = List.Flatten(list=name)
code_block_2 = CodeBlock { 1; }
chop = List.Chop(list=flatten, lengths=code_block_2)
element_types_2 = ElementTypes(index=230)
