# Dynamo graph PIPE - Place Pipe Connectors by System.dyn "000 - Place Pipe Connectors by System" (Dynamo 2.1.0.7500)

by2MEPCurves = Custom[Tee.By2MEPCurves]()  # Creates a tee by a main curve and a branch MEP curve (duct, pipe, conduit, cable tray). Only works with perpendicular brand curves; unwired: Main_MEPCurve, Branch_MEPCurve
select_select_pipes = DSModelElementsSelection()  # 447 picked in the model; graph input
code_block = CodeBlock { "Pipes"; }
byName = Category.ByName(name=code_block)
byCategory = Revit.ElementFilter.ByCategory(element=select_select_pipes, category=byName)
code_block_2 = CodeBlock { "System Abbreviation"; }
piping_system_abbreviation_only = StringInput("UW1")  # "Piping System Abbreviation: (only Pipes with this Abbreviation will receive elbows)"; graph input
byParameterEquals = Revit.ElementFilter.ByParameterEquals(element=byCategory, parameterName=code_block_2, value=piping_system_abbreviation_only)
integer_use_this_number_to_tune = IntegerSlider(1, range=0..10 step 1)  # "Integer: (Use this number to "tune" the number of Elbows generated. Smaller integer = fewer elbows.)"
byMEPCurves = Custom[Elbow.ByMEPCurves](MEPCurves=byParameterEquals, Margin=integer_use_this_number_to_tune)  # Takes in a list of MEPCurves (pipe, duct, cable tray, conduit) and will attempt to create elbows where possible. A margin can be entered for max distance between connectors
