# Dynamo graph PIPE - Place Pipe Sleeves at Clash.dyn (Dynamo 2.1.0.7500)

select_category_a_to_be_clash = Categories("OST_PipeCurves")  # "Select Category A to be Clash Detected against Category B"; graph input
all_elements_of_category = ElementsOfCategory(Category=select_category_a_to_be_clash)

# group: Credit to Jona of the Dynamo Forum for the origin of this graph.
select_category_b_to_be_clash = Categories("OST_Floors")  # "Select Category B to be Clash Detected against Category A"; graph input
all_elements_of_category_2 = ElementsOfCategory(Category=select_category_b_to_be_clash)

# group: Clash and Filter
revit_element_clash_detection_v1 = Custom[Revit Element Clash Detection v1](RevitElementSetA=all_elements_of_category, RevitElementSetB=all_elements_of_category_2)
code_block = CodeBlock()  # // Bakery

# group: insert family at point location
select_the_family_to_be_placed = FamilyTypes("Sleeve Long Solid - MJ - GI - Class 150:Standard")  # "Select the Family to be Placed at Each Clash Location (If Automatic Sizing is desired, please use OOTB Revit Pipe Sleeves)"; graph input
transpose = List.Transpose(lists=revit_element_clash_detection_v1.clashPoint)
byPoint = FamilyInstance.ByPoint(familyType=select_the_family_to_be_placed, point=transpose)

# group: set rotation of pipe sleeve
XAxis = Vector.XAxis()
location = Custom[Element.Location](element=revit_element_clash_detection_v1.clashSetA)  # Returns the location of an element as point, curve or curve loop, along with some booleans to help filtering the results. Unlike the OOTB Element.GetLocation node, it also retunrs sketch lines of sketch-based elements like floor slabs as well as the element's rotation property.
direction = Line.Direction(line=location.curves)
angleWithVector = Vector.AngleWithVector(vector=XAxis, otherVector=direction)
number = DoubleInput(0.25)  # graph input
round = Custom[Math.Round+](dbl=angleWithVector, precision=number)  # Rounds a number to a specified precision
setRotation = FamilyInstance.SetRotation(familyInstance=byPoint, degree=round)
code_block_2 = CodeBlock()  # //Clockwork

# group: Set sleeve length
code_block_3 = CodeBlock { "Length"; }
bv_get_wall_width = Custom[bv Get Wall Width](Wall_s=revit_element_clash_detection_v1.clashSetB)  # from steam nodes
setParameterByName = Element.SetParameterByName(element=byPoint, parameterName=code_block_3, value=bv_get_wall_width)
code_block_4 = CodeBlock()  # //Bakery

# group: Set sleeve radius
code_block_5 = CodeBlock { "Nominal Radius"; }
code_block_6 = CodeBlock { "Outside Diameter"; }
getParameterValueByName = Element.GetParameterValueByName(element=revit_element_clash_detection_v1.clashSetA, parameterName=code_block_6)
number_2 = DoubleInput(0.5)  # graph input
mul = getParameterValueByName * number_2
setParameterByName_2 = Element.SetParameterByName(element=byPoint, parameterName=code_block_5, value=mul)

# group: Set sleeve radius
code_block_7 = CodeBlock { "Nominal Radius"; }
code_block_8 = CodeBlock { "Outside Diameter"; }
getParameterValueByName_2 = Element.GetParameterValueByName(element=revit_element_clash_detection_v1.clashSetA, parameterName=code_block_8)
number_3 = DoubleInput(0.5)  # graph input
mul_2 = getParameterValueByName_2 * number_3
setParameterByName_3 = Element.SetParameterByName(element=byPoint, parameterName=code_block_7, value=mul_2)

# group: Set System Type
code_block_9 = CodeBlock { "System Type"; }
element_types = ElementTypes("PipingSystemType")
all_elements_of_type = ElementsOfType(element_type=element_types)
name = Element.Name(element=all_elements_of_type)
code_block_10 = CodeBlock { "System Type"; }
getParameterValueByName_3 = Element.GetParameterValueByName(element=revit_element_clash_detection_v1.clashSetA, parameterName=code_block_10)
name_2 = Element.Name(element=getParameterValueByName_3)
indexOf = List.IndexOf(list=name, element=name_2)
getItemAtIndex = List.GetItemAtIndex(list=all_elements_of_type, index=indexOf)
setParameterByName_4 = Element.SetParameterByName(element=byPoint, parameterName=code_block_9, value=getItemAtIndex)

ZAxis = Vector.ZAxis()
