# Dynamo graph Trace Fire Ratings.dyn (Dynamo 1.2.1.3083)

all_elements_in_active_view = ElementsInView()
create = List.Create(all_elements_in_active_view)
code_block = CodeBlock { 0; }
getItemAtIndex = List.GetItemAtIndex(list=create, index=code_block)
code_block_2 = CodeBlock { "Type"; }
getParameterValueByName = Element.GetParameterValueByName(element=getItemAtIndex, parameterName=code_block_2)
string_from_object = FromObject(getParameterValueByName)
code_block_3 = CodeBlock { "1-HR Fire"; "1-HR Smoke"; "2-HR Fire"; "2-HR Smoke"; }
string_contains_1_hr_fire = String.Contains(str=string_from_object, searchFor=code_block_3.out0)
filterByBoolMask = List.FilterByBoolMask(list=getItemAtIndex, mask=string_contains_1_hr_fire)
location = Custom[Element.Location 1-HR Fire](element=filterByBoolMask.in)  # "Element.Location"; Returns the location of an element as an XYZ (or if it's line-based the start and end point of the line), along with some booleans to help filtering the results. Use this for some element types (e.g. walls or lines) that do not work with the built-in Get Family Instance Location node.

# group: Rating Tapes
n1_hr_fire = FamilyTypes("DTL - LINE - LS - Wall Rating 1-HR FIRE+SMOKE:DTL - LINE - LS - Wall Rating 1-HR FIRE")  # "1-HR FIRE"
n1_hr_smoke = FamilyTypes()  # "1-HR SMOKE"
n2_hr_fire = FamilyTypes("DTL - LINE - LS - Wall Rating 2-HR FIRE+SMOKE:DTL - LINE - LS - Wall Rating 2-HR FIRE")  # "2-HR FIRE"
n2_hr_smoke = FamilyTypes()  # "2-HR SMOKE"

levels = Levels()
byCurve = Custom[FamilyInstance.ByCurve](curve=location.curves, familyType=n1_hr_fire, level=levels)  # Places a line-based family instance on a given level
string_contains_1_hr_smoke = String.Contains(str=string_from_object, searchFor=code_block_3.out1)
filterByBoolMask_2 = List.FilterByBoolMask(list=getItemAtIndex, mask=string_contains_1_hr_smoke)
location_2 = Custom[Element.Location 1-HR Smoke](element=filterByBoolMask_2.in)  # "Element.Location"; Returns the location of an element as an XYZ (or if it's line-based the start and end point of the line), along with some booleans to help filtering the results. Use this for some element types (e.g. walls or lines) that do not work with the built-in Get Family Instance Location node.
byCurve_2 = Custom[FamilyInstance.ByCurve](curve=location_2.curves, familyType=n1_hr_smoke, level=levels)
string_contains_2_hr_smoke = String.Contains(str=string_from_object, searchFor=code_block_3.out2)
filterByBoolMask_3 = List.FilterByBoolMask(list=getItemAtIndex, mask=string_contains_2_hr_smoke)
location_3 = Custom[Element.Location 2-HR Fire](element=filterByBoolMask_3.in)  # "Element.Location"; Returns the location of an element as an XYZ (or if it's line-based the start and end point of the line), along with some booleans to help filtering the results. Use this for some element types (e.g. walls or lines) that do not work with the built-in Get Family Instance Location node.
byCurve_3 = Custom[FamilyInstance.ByCurve](curve=location_3.curves, familyType=n2_hr_fire, level=levels)
string_contains_2_hr_smoke_2 = String.Contains(str=string_from_object, searchFor=code_block_3.out3)
filterByBoolMask_4 = List.FilterByBoolMask(list=getItemAtIndex, mask=string_contains_2_hr_smoke_2)
location_4 = Custom[Element.Location 2-HR Smoke](element=filterByBoolMask_4.in)  # "Element.Location"; Returns the location of an element as an XYZ (or if it's line-based the start and end point of the line), along with some booleans to help filtering the results. Use this for some element types (e.g. walls or lines) that do not work with the built-in Get Family Instance Location node.
byCurve_4 = Custom[FamilyInstance.ByCurve](curve=location_4.curves, familyType=n2_hr_smoke, level=levels)
create_2 = List.Create(byCurve, byCurve_2, byCurve_3, byCurve_4)
code_block_4 = CodeBlock { 1; }
flatten = List.Flatten(list=create_2, amt=code_block_4)
